# Dynamo graph CRIAR DETALHES_script.dyn (Dynamo 2.17.0.3472)
# author: Luís Eduardo Maia Ferreira
# Duplica as familias de detalhes tipicos de janela conforme a largura, altura e peitoril das janelas utilizadas no projeto.
# packages: archi-lab.net 2024.217.1024, Rhythm 2023.7.3

# note: gerar local do arquivo

file_path = Filename("..\..\..\..\..\..\00-DOCUMENTOS DE APOIO\JANELAS-DETALHES.csv")
importCSV = Data.ImportCSV(filePath=file_path)
string = StringInput(";")
split = String.Split(string=importCSV, separator0=string)
python_script = Python(IN[0]=split)  # IronPython2
# ---------- python_script.python (18 lines) ----------
# Entrada: IN[0] = lista aninhada em até 4 níveis (pode conter listas vazias)
input_list = IN[0]

def remove_empty_lists(lst):
    cleaned = []
    for item in lst:
        if isinstance(item, list):
            # limpa recursivamente sub-listas
            sub = remove_empty_lists(item)
            # só adiciona se não for vazia após limpeza
            if sub:
                cleaned.append(sub)
        else:
            cleaned.append(item)
    return cleaned

# Saída: mesma estrutura, mas sem listas vazias em nenhum nível
OUT = remove_empty_lists(input_list)
# ----------------------------------------
code_block = CodeBlock { 0; }
getItemAtIndex = List.GetItemAtIndex(list=python_script@L2, index=code_block)
code_block_2 = CodeBlock { 1; }
dropItems = List.DropItems(list=getItemAtIndex, amount=code_block_2)
code_block_3 = CodeBlock { 1; }
getItemAtIndex_2 = List.GetItemAtIndex(list=python_script@L2, index=code_block_3)
dropItems_2 = List.DropItems(list=getItemAtIndex_2, amount=code_block_2)
byName = Family.ByName(name=dropItems_2)
code_block_4 = CodeBlock { "JANELA BASE"; }
byFamilyAndName = FamilyType.ByFamilyAndName(family=byName, name=code_block_4)
byKeysValues = DesignScript.Builtin.Dictionary.ByKeysValues(keys=dropItems, values=byFamilyAndName)
end = Revit.Transaction.Transaction.End(input=byKeysValues)

# group: PEGAR 1 JANELA DE CADA TIPO
categories = Categories("OST_Windows")
all_elements_of_category = ElementsOfCategory(Category=categories)

# group: pegar somente as que tem fase criada como nova
watch = Watch(all_elements_of_category)
code_block_5 = CodeBlock { "Construção nova"; }
code_block_6 = CodeBlock { "Fase criada"; }
getParameterValueByName = Element.GetParameterValueByName(element=watch, parameterName=code_block_6)
name = Element.Name(element=getParameterValueByName)
code_block_7 = CodeBlock(a=code_block_5, b=name) { a==b; }
filterByBoolMask = List.FilterByBoolMask(list=watch, mask=code_block_7)

# group (continued): PEGAR 1 JANELA DE CADA TIPO
name_2 = Family.Name(family=filterByBoolMask.in)
groupByKey = List.GroupByKey(list=filterByBoolMask.in, keys=name_2)
firstItem = List.FirstItem(list=groupByKey.groups@L2)

# group: GERAR TEXTOS DO POP UP > CRIAR TEXTO COM NUMERO DE JANELAS E TIPOS
count = List.Count(list=filterByBoolMask.in)
count_2 = List.Count(list=firstItem)
code_block_8 = CodeBlock(a=count, b=count_2) { "Exitem "+a+" janelas no seu projeto divididas em "+b+" tipos:"; }

# group: GERAR TEXTOS DO POP UP > PEGAR VALOR DA MARCA DE TIPO E CRIAR LISTA
code_block_9 = CodeBlock { ", "; }
type = archilab.Revit.Elements.Elements.Type(element=firstItem)
watch_2 = Watch(type)
code_block_10 = CodeBlock { "Marca de tipo"; }
getParameterValueByName_2 = Element.GetParameterValueByName(element=watch_2, parameterName=code_block_10)
sortByKey = List.SortByKey(list=getParameterValueByName_2, keys=getParameterValueByName_2)
join = String.Join(separator=code_block_9, string0=sortByKey.sortedList)

# group: GERAR TEXTOS DO POP UP
# note: Procurar CSV onde estão listados os detalhes e as portas
# note: lista dos nomes de portas
# note: lista dos nomes de detalhes
# note: SELECIONA O DOCUMENTO ATUAL E EXTRAI O LOCAL
# note: pega o nome do arquivo atual
code_block_11 = CodeBlock(c=join) { ""+c+". Prosseguir com detalhamento?"; }

# group: POP UP 1
ʳʰʸᵗʰᵐ_helpers_usermessage = Rhythm.Revit.Helpers.Helpers.UserMessage(caption=code_block_8, message=code_block_11, obj=firstItem)

flatten = List.Flatten(list=ʳʰʸᵗʰᵐ_helpers_usermessage)
type_2 = archilab.Revit.Elements.Elements.Type(element=flatten)

# group: PEGAR VALOR DO NOME SEM MEDIDAS
watch_3 = Watch(type_2)
string_from_object = FromObject(object=watch_3)
code_block_12 = CodeBlock { "Family: "; }
split_2 = String.Split(string=string_from_object, separator0=code_block_12)
flatten_2 = List.Flatten(list=split_2)
code_block_13 = CodeBlock { 2; -1; }
dropEveryNthItem = List.DropEveryNthItem(list=flatten_2, n=code_block_13.out0, offset=code_block_13.out1)
code_block_14 = CodeBlock { " - "; }

# group: APLICAR DICIONARIO
valueAtKey = DesignScript.Builtin.Dictionary.ValueAtKey(dictionary=end, key=dropEveryNthItem)

# group: tirar os nulos
string_from_object_2 = FromObject(object=valueAtKey)
code_block_15 = CodeBlock(A=string_from_object_2) { A=="null"; }
filterByBoolMask_2 = List.FilterByBoolMask(list=valueAtKey, mask=code_block_15)

type_3 = archilab.Revit.Elements.Elements.Type(element=flatten)

# group: PEGAR VALOR DA LARGURA
watch_4 = Watch(type_3)
code_block_16 = CodeBlock { "Largura"; }
getParameterValueByName_3 = Element.GetParameterValueByName(element=watch_4, parameterName=code_block_16)
round = Math.Round(number=getParameterValueByName_3)
string_from_object_3 = FromObject(object=round)
code_block_17 = CodeBlock { ",000000"; }
code_block_18 = CodeBlock { ""; }
replace = String.Replace(string=string_from_object_3, searchFor=code_block_17, replaceWith=code_block_18)
code_block_19 = CodeBlock { " x "; }

# group: PEGAR VALOR DA ALTURA
watch_5 = Watch(type_3)
code_block_20 = CodeBlock { "Altura"; }
getParameterValueByName_4 = Element.GetParameterValueByName(element=watch_5, parameterName=code_block_20)
round_2 = Math.Round(number=getParameterValueByName_4)
string_from_object_4 = FromObject(object=round_2)
code_block_21 = CodeBlock { ",000000"; }
code_block_22 = CodeBlock { ""; }
replace_2 = String.Replace(string=string_from_object_4, searchFor=code_block_21, replaceWith=code_block_22)
code_block_23 = CodeBlock { " x "; }

# group: PEGAR VALOR DO PEITORIL
watch_6 = Watch(flatten)
code_block_24 = CodeBlock { "Altura do peitoril"; }
getParameterValueByName_5 = Element.GetParameterValueByName(element=watch_6, parameterName=code_block_24)
round_3 = Math.Round(number=getParameterValueByName_5)
string_from_object_5 = FromObject(object=round_3)
code_block_25 = CodeBlock { ",000000"; }
code_block_26 = CodeBlock { ""; }
replace_3 = String.Replace(string=string_from_object_5, searchFor=code_block_25, replaceWith=code_block_26)
code_block_27 = CodeBlock { " - "; }

type_4 = archilab.Revit.Elements.Elements.Type(element=flatten)

# group: PEGAR VALOR DA MARCA DE TIPO
watch_7 = Watch(type_4)
code_block_28 = CodeBlock { "Marca de tipo"; }
getParameterValueByName_6 = Element.GetParameterValueByName(element=watch_7, parameterName=code_block_28)
string_from_object_6 = FromObject(object=getParameterValueByName_6)
code_block_29 = CodeBlock { ",000000"; }
code_block_30 = CodeBlock { ""; }
replace_4 = String.Replace(string=string_from_object_6, searchFor=code_block_29, replaceWith=code_block_30)

# group: CRIAR NOVO NOME
code_block_31 = CodeBlock(a=dropEveryNthItem, b=code_block_14, c=replace, d=code_block_19, f=replace_2, g=code_block_23, h=replace_3, i=code_block_27, j=replace_4) { a+b+c+d+f+g+h+i+j; }

# group: limpar os nomes (Usar String.Replace para substituir ARQ-JAN, -MET-, -ALUL,-MAD- POR nada)
code_block_32 = CodeBlock(t1=code_block_31)
# ---------- code_block_32.designscript (5 lines) ----------
str6 = DSCore.String.Replace(t1, "ARQ-JAN", "");
str7 = DSCore.String.Replace(str6, "-MET-", "");
str8 = DSCore.String.Replace(str7, "-MET-", "");
str9 = DSCore.String.Replace(str8, "-ALU-", "");
str10 = DSCore.String.Replace(str9, "-MAD-", "");
# ----------------------------------------

filterByBoolMask_3 = List.FilterByBoolMask(list=code_block_32.str10, mask=code_block_15)

# group: DUPLICAR FAMILIAS
duplicate = ElementType.Duplicate(elementType=filterByBoolMask_2.out, name=filterByBoolMask_3.out)

type_5 = archilab.Revit.Elements.Elements.Type(element=flatten)

# group: PEGAR VALOR DA MARCA num. de folhas
watch_8 = Watch(type_5)
code_block_33 = CodeBlock { "NUM. FOLHAS"; }
getParameterValueByName_7 = Element.GetParameterValueByName(element=watch_8, parameterName=code_block_33)

# group: DEFINIR NUM. DE FOLHAS NA JANELA COM PARAMETRO DE NUMERO DE FOLHAS
code_block_34 = CodeBlock { "QUANTIDADE FOLHAS"; }
setParameterByName = Element.SetParameterByName(element=duplicate, parameterName=code_block_34, value=getParameterValueByName_7)

watch_9 = Watch(dropEveryNthItem)
watch_10 = Watch(ʳʰʸᵗʰᵐ_helpers_usermessage)
flatten_3 = List.Flatten(list=watch_10)
firstItem_2 = List.FirstItem(list=flatten_3)

# group: PEGAR SOMENTE OS NULOS
filterByBoolMask_4 = List.FilterByBoolMask(list=flatten_3, mask=code_block_15)
não_foram_criados_detalhes_dos = Watch(filterByBoolMask_4.in)  # "NÃO FORAM CRIADOS DETALHES DOS SEGUINTES ELEMENTOS"; graph output

# group: CRIAR MENSAGEM FINAL
code_block_35 = CodeBlock { "Mensagem:"; }
isNullOrEmpty = archilab.Core.Strings.IsNullOrEmpty(str=firstItem_2)
code_block_36 = CodeBlock { "Processo cancelado"; }
string_from_object_7 = FromObject(object=não_foram_criados_detalhes_dos)
isEmpty = List.IsEmpty(list=string_from_object_7)
code_block_37 = CodeBlock(a=isEmpty) { a==true; }
code_block_38 = CodeBlock(a=string_from_object_7) { "Os detalhes foram criados."; "Não foi criado detalhe da janela '"+a+"' rever família ou detalhar manualmente."; }
if_ = RefactoredIf(test=code_block_37, true=code_block_38.out0, false=code_block_38.out1)
if_2 = RefactoredIf(test=isNullOrEmpty, true=code_block_36, false=if_)
ʳʰʸᵗʰᵐ_helpers_simpleusermessage = Rhythm.Revit.Helpers.Helpers.SimpleUserMessage(caption=code_block_35, message=if_2)  # frozen

# group: REALÇAR OS QUE DERAM ERRADO
color_palette = ColorPalette({R: 255, G: 0, B: 0, A: 255})
overrideColorInView = Element.OverrideColorInView(element=não_foram_criados_detalhes_dos, color=color_palette)

code_block_39 = CodeBlock { null; }
directory_path = Directory("G:\Drives compartilhados\BIM\AUTOMACAO\TOOLBAR\00-DOCUMENTOS DE APOIO\ESQUADRIAS PENDENTES")
string_from_object_8 = FromObject(object=directory_path)
string_2 = StringInput("\JNL-SEM-DET ")
now = DateTime.Now()
string_from_object_9 = FromObject(object=now)
code_block_40 = CodeBlock { "/"; ":"; "-"; }
replace_5 = String.Replace(string=string_from_object_9, searchFor=code_block_40.out0, replaceWith=code_block_40.out2)
replace_6 = String.Replace(string=replace_5, searchFor=code_block_40.out1, replaceWith=code_block_40.out2)
string_3 = StringInput(".csv")
code_block_41 = CodeBlock(A=string_from_object_8, B=string_2, C=replace_6, D=string_3) { A+B+C+D; }
if_3 = RefactoredIf(test=code_block_37, true=code_block_39, false=code_block_41)
watch_11 = Watch(if_3)
current = Document.Current()
filePath = Document.FilePath(document=current)
string_4 = StringInput("\")
split_3 = String.Split(string=filePath, separator0=string_4)
lastItem = List.LastItem(list=split_3)
string_5 = StringInput(".")
split_4 = String.Split(string=lastItem, separator0=string_5)
firstItem_3 = List.FirstItem(list=split_4)
filterByBoolMask_5 = List.FilterByBoolMask(list=code_block_32.str10, mask=code_block_15)
watch_12 = Watch(filterByBoolMask_5.in)
list_create = List.Create(item0=firstItem_3, item1=watch_12)
flatten_4 = List.Flatten(list=list_create)
exportCSV = Data.ExportCSV(filePath=watch_11, data=flatten_4)
