# Dynamo graph PA - ESQUADRIAS - PORTAS - CRIAR DETALHES._script.dyn (Dynamo 2.17.0.3472)
# author: Luís Eduardo Maia Ferreira
# Duplica as familias de detalhes tipicos de porta conforme a largura e altura das portas utilizadas no projeto.
# packages: archi-lab.net 2024.217.1024, Rhythm 2023.7.3

# note: PEGAR VALOR DA MARCA DE TIPO E CRIAR LISTA
# note: CRIAR TEXTO COM NUMERO DE JANELAS E TIPOS

# group: CRIAR E DICIONARIO (COM BASE EM CSV) > Procurar CSV onde estão listados os detalhes e as portas
file_path = Filename("..\..\Drives compartilhados\BIM\AUTOMACAO\TOOLBAR\00-DOCUMENTOS DE APOIO\PORTAS-DETALHES.csv")
importCSV = Data.ImportCSV(filePath=file_path)
string = StringInput(";")
split = String.Split(string=importCSV, separator0=string)

# group: CRIAR E DICIONARIO (COM BASE EM CSV)
code_block = CodeBlock { 0; }
code_block_2 = CodeBlock { 1; }
code_block_3 = CodeBlock { 1; }
code_block_4 = CodeBlock { "PORTA BASE"; }

# group: CRIAR E DICIONARIO (COM BASE EM CSV) > lista dos nomes de portas
getItemAtIndex = List.GetItemAtIndex(list=split@L2, index=code_block)

# group (continued): CRIAR E DICIONARIO (COM BASE EM CSV)
dropItems = List.DropItems(list=getItemAtIndex, amount=code_block_2)

# group: CRIAR E DICIONARIO (COM BASE EM CSV) > lista dos nomes de detalhes
getItemAtIndex_2 = List.GetItemAtIndex(list=split@L2, index=code_block_3)

# group (continued): CRIAR E DICIONARIO (COM BASE EM CSV)
dropItems_2 = List.DropItems(list=getItemAtIndex_2, amount=code_block_2)
byName = Family.ByName(name=dropItems_2)
byFamilyAndName = FamilyType.ByFamilyAndName(family=byName, name=code_block_4)
byKeysValues = DesignScript.Builtin.Dictionary.ByKeysValues(keys=dropItems, values=byFamilyAndName)

end = Revit.Transaction.Transaction.End(input=byKeysValues)

# group: PEGAR 1 JANELA DE CADA TIPO
categories = Categories("OST_Doors")
all_elements_of_category = ElementsOfCategory(Category=categories)

# group: pegar somente as que tem fase criada como nova
code_block_5 = CodeBlock { "Construção nova"; }
code_block_6 = CodeBlock { "Fase criada"; }
getParameterValueByName = Element.GetParameterValueByName(element=all_elements_of_category, parameterName=code_block_6)
name = Element.Name(element=getParameterValueByName)
code_block_7 = CodeBlock(a=code_block_5, b=name) { a==b; }
filterByBoolMask = List.FilterByBoolMask(list=all_elements_of_category, mask=code_block_7)

# group (continued): PEGAR 1 JANELA DE CADA TIPO
type = archilab.Revit.Elements.Elements.Type(element=filterByBoolMask.in)
groupByKey = List.GroupByKey(list=filterByBoolMask.in, keys=type)
firstItem = List.FirstItem(list=groupByKey.groups@L2)

# group: Mensagem para confirmar portas e marcas de tipo
count = List.Count(list=filterByBoolMask.in)
count_2 = List.Count(list=firstItem)
code_block_8 = CodeBlock(a=count, b=count_2) { "Exitem "+a+" portas no seu projeto divididas em "+b+" tipos:"; }
code_block_9 = CodeBlock { ", "; }
type_2 = archilab.Revit.Elements.Elements.Type(element=firstItem)
watch = Watch(type_2)
code_block_10 = CodeBlock { "Marca de tipo"; }
getParameterValueByName_2 = Element.GetParameterValueByName(element=watch, parameterName=code_block_10)
sortByKey = List.SortByKey(list=getParameterValueByName_2, keys=getParameterValueByName_2)
join = String.Join(separator=code_block_9, string0=sortByKey.sortedList)
code_block_11 = CodeBlock(c=join) { ""+c+". Prosseguir com detalhamento?"; }

# group: POP UP 1
ʳʰʸᵗʰᵐ_helpers_usermessage = Rhythm.Revit.Helpers.Helpers.UserMessage(caption=code_block_8, message=code_block_11, obj=firstItem)

flatten = List.Flatten(list=ʳʰʸᵗʰᵐ_helpers_usermessage)

# group: PEGAR NOME DO TIPO
code_block_12 = CodeBlock { "Família"; }
getParameterValueByName_3 = Element.GetParameterValueByName(element=flatten, parameterName=code_block_12)
string_from_object = FromObject(object=getParameterValueByName_3)
code_block_13 = CodeBlock { ", Family:"; }
split_2 = String.Split(string=string_from_object, separator0=code_block_13)
flatten_2 = List.Flatten(list=split_2)
number = DoubleInput(2)
number_2 = DoubleInput(-1)
dropEveryNthItem = List.DropEveryNthItem(list=flatten_2, n=number, offset=number_2)

type_3 = archilab.Revit.Elements.Elements.Type(element=ʳʰʸᵗʰᵐ_helpers_usermessage)
flatten_3 = List.Flatten(list=type_3)

# group: PEGAR MATERIAL
code_block_14 = CodeBlock { "PA - MATERIAL DA PORTA"; }
getParameterValueByName_4 = Element.GetParameterValueByName(element=flatten_3, parameterName=code_block_14)
python_script = Python(IN[0]=getParameterValueByName_4)  # IronPython2
# ---------- python_script.python (43 lines) ----------
# ————————————————————————————————————————————————————————————————
# Script IronPython 2 para Dynamo: replicar o node Element.Name com tratamento de nulos
#
# ENTRADA:
#   IN[0] = elemento único ou lista de elementos (wrappers do Dynamo), podendo conter None ou itens inválidos
#
# SAÍDA:
#   OUT = nome (string) ou lista de nomes; retorna "null" quando item for None ou não tiver nome
# ————————————————————————————————————————————————————————————————

import clr
clr.AddReference('RevitAPI')
clr.AddReference('RevitServices')
clr.AddReference('RevitNodes')

import Revit
clr.ImportExtensions(Revit.Elements)

from RevitServices.Persistence import DocumentManager

# Lê a entrada
input_items = IN[0]

def get_name(item):
    # item None ou falha no Unwrap → "null"
    if item is None:
        return "null"
    try:
        el = UnwrapElement(item)
    except:
        return "null"
    # tenta ler o Name; se faltar ou for None, retorna "null"
    try:
        name = el.Name
        return name if name is not None else "null"
    except:
        return "null"

# Se for lista, retorna lista de nomes; senão, um único nome
if isinstance(input_items, list):
    OUT = [get_name(i) for i in input_items]
else:
    OUT = get_name(input_items)
# ----------------------------------------
python_script_2 = Python(IN[0]=python_script)  # IronPython2
# ---------- python_script_2.python (18 lines) ----------
# -*- coding: utf-8 -*-

input_list = IN[0]

def process_string(s):
    # Se for None ou a string literal "null", mantém "null"
    if s is None or (isinstance(s, basestring) and s.strip().lower() == "null"):
        return "null"
    # converte para minúsculas pra comparar
    s_lower = s.lower()
    if "madeira" in s_lower:
        return "MADEIRA"
    elif "metal" in s_lower or "aluminio" in s_lower:
        return "METAL"
    else:
        return "PINTURA BRANCA"

OUT = [process_string(item) for item in input_list]
# ----------------------------------------
code_block_15 = CodeBlock { " - "; }

# group: PEGAR SE É PNE
code_block_16 = CodeBlock { "EQUIPAMENTO PNE"; }
getParameterValueByName_5 = Element.GetParameterValueByName(element=flatten_3, parameterName=code_block_16)
string_from_object_2 = FromObject(object=getParameterValueByName_5)
code_block_17 = CodeBlock { "0"; ""; }
replace = String.Replace(string=string_from_object_2, searchFor=code_block_17.out0, replaceWith=code_block_17.out1)
code_block_18 = CodeBlock { "1"; "_PNE"; }
replace_2 = String.Replace(string=replace, searchFor=code_block_18.out0, replaceWith=code_block_18.out1)

# group: PEGAR SE É DE CORRER
code_block_19 = CodeBlock { "De correr"; }
getParameterValueByName_6 = Element.GetParameterValueByName(element=flatten_3, parameterName=code_block_19)
string_from_object_3 = FromObject(object=getParameterValueByName_6)
code_block_20 = CodeBlock { "0"; ""; }
replace_3 = String.Replace(string=string_from_object_3, searchFor=code_block_20.out0, replaceWith=code_block_20.out1)
code_block_21 = CodeBlock { "1"; "_CORRER"; }
replace_4 = String.Replace(string=replace_3, searchFor=code_block_21.out0, replaceWith=code_block_21.out1)

code_block_22 = CodeBlock(A=dropEveryNthItem, C=python_script_2, D=replace_2, E=replace_4) { A+"_"+C+D+E; }
trimWhitespace = String.TrimWhitespace(string=code_block_22)

# group: APLICAR DICIONARIO
valueAtKey = DesignScript.Builtin.Dictionary.ValueAtKey(dictionary=end, key=trimWhitespace)

code_block_23 = CodeBlock { "null"; "PORTA"; }
replace_5 = String.Replace(string=python_script_2, searchFor=code_block_23.out0, replaceWith=code_block_23.out1)

# group: PEGAR VALOR DA LARGURA
watch_2 = Watch(flatten_3)
code_block_24 = CodeBlock { "Largura"; }
getParameterValueByName_7 = Element.GetParameterValueByName(element=watch_2, parameterName=code_block_24)
round = Math.Round(number=getParameterValueByName_7)
string_from_object_4 = FromObject(object=round)
code_block_25 = CodeBlock { ",000000"; }
code_block_26 = CodeBlock { ""; }
replace_6 = String.Replace(string=string_from_object_4, searchFor=code_block_25, replaceWith=code_block_26)
code_block_27 = CodeBlock { " x "; }

# group: PEGAR VALOR DA ALTURA
watch_3 = Watch(flatten_3)
code_block_28 = CodeBlock { "Altura"; }
getParameterValueByName_8 = Element.GetParameterValueByName(element=watch_3, parameterName=code_block_28)
round_2 = Math.Round(number=getParameterValueByName_8)
string_from_object_5 = FromObject(object=round_2)
code_block_29 = CodeBlock { ",000000"; }
code_block_30 = CodeBlock { ""; }
replace_7 = String.Replace(string=string_from_object_5, searchFor=code_block_29, replaceWith=code_block_30)
code_block_31 = CodeBlock { " x "; }

# group: PEGAR VALOR DA MARCA DE TIPO
watch_4 = Watch(flatten_3)
code_block_32 = CodeBlock { "Marca de tipo"; }
getParameterValueByName_9 = Element.GetParameterValueByName(element=watch_4, parameterName=code_block_32)
string_from_object_6 = FromObject(object=getParameterValueByName_9)
code_block_33 = CodeBlock { ",000000"; }
code_block_34 = CodeBlock { ""; }
replace_8 = String.Replace(string=string_from_object_6, searchFor=code_block_33, replaceWith=code_block_34)

# group: CRIAR NOVO NOME
code_block_35 = CodeBlock(a=replace_5, b=code_block_15, c=replace_6, d=code_block_27, f=replace_7, g=code_block_31, h=replace_8) { a+b+c+d+f+g+h; }

# group: TIRAR NULOS
string_from_object_7 = FromObject(object=valueAtKey)
code_block_36 = CodeBlock(A=string_from_object_7) { A=="null"; }
filterByBoolMask_2 = List.FilterByBoolMask(list=valueAtKey, mask=code_block_36)
filterByBoolMask_3 = List.FilterByBoolMask(list=code_block_35, mask=code_block_36)

# group: DUPLICAR FAMILIAS
duplicate = ElementType.Duplicate(elementType=filterByBoolMask_2.out, name=filterByBoolMask_3.out)

watch_5 = Watch(flatten)
firstItem_2 = List.FirstItem(list=watch_5)
string_from_object_8 = FromObject(object=firstItem_2)

# group: VER OS QUE DERAM ERRADO
filterByBoolMask_4 = List.FilterByBoolMask(list=watch_5, mask=code_block_36)
nao_foram_criados_detalhes_ara = Watch(filterByBoolMask_4.in)  # "NAO FORAM CRIADOS DETALHES ARA ESSES ELEMENTOS"

# group: CRIAR MENSAGEM FINAL
code_block_37 = CodeBlock { "Mensagem:"; }
code_block_38 = CodeBlock(a=string_from_object_8) { a=="null"; }
code_block_39 = CodeBlock { "Processo cancelado"; }
string_from_object_9 = FromObject(object=nao_foram_criados_detalhes_ara)
isEmpty = List.IsEmpty(list=string_from_object_9)
code_block_40 = CodeBlock(a=isEmpty) { a==true; }
code_block_41 = CodeBlock(a=string_from_object_9)
# ---------- code_block_41.designscript (2 lines) ----------
"Os detalhes foram criados.";
"Não foi criado detalhe da porta '"+a+"' rever família ou detalhar manualmente. Foram criados detalhes das demais portas.";
# ----------------------------------------
if_ = RefactoredIf(test=code_block_40, true=code_block_41.out0, false=code_block_41.out1)
if_2 = RefactoredIf(test=code_block_38, true=code_block_39, false=if_)
ʳʰʸᵗʰᵐ_helpers_simpleusermessage = Rhythm.Revit.Helpers.Helpers.SimpleUserMessage(caption=code_block_37, message=if_2)

# group: REALÇAR OS QUE DERAM ERRADO
color_palette = ColorPalette({R: 255, G: 0, B: 0, A: 255})
overrideColorInView = Element.OverrideColorInView(element=nao_foram_criados_detalhes_ara, color=color_palette)

code_block_42 = CodeBlock { null; }

# group: gerar csv com lista de famílias de porta que não foram contempladas pela rotina > gerar local do arquivo
directory_path = Directory("G:\Drives compartilhados\BIM\AUTOMACAO\TOOLBAR\00-DOCUMENTOS DE APOIO\ESQUADRIAS PENDENTES")
string_from_object_10 = FromObject(object=directory_path)
string_2 = StringInput("\PRT-SEM-DET ")
now = DateTime.Now()
string_from_object_11 = FromObject(object=now)
code_block_43 = CodeBlock { "/"; ":"; "-"; }
replace_9 = String.Replace(string=string_from_object_11, searchFor=code_block_43.out0, replaceWith=code_block_43.out2)
replace_10 = String.Replace(string=replace_9, searchFor=code_block_43.out1, replaceWith=code_block_43.out2)
string_3 = StringInput(".csv")
code_block_44 = CodeBlock(A=string_from_object_10, B=string_2, C=replace_10, D=string_3) { A+B+C+D; }

if_3 = RefactoredIf(test=code_block_40, true=code_block_42, false=code_block_44)

# group: gerar csv com lista de famílias de porta que não foram contempladas pela rotina > SELECIONA O DOCUMENTO ATUAL E EXTRAI O LOCAL
current = Document.Current()
filePath = Document.FilePath(document=current)

# group: gerar csv com lista de famílias de porta que não foram contempladas pela rotina > pega o nome do arquivo atual
string_4 = StringInput("\")
split_3 = String.Split(string=filePath, separator0=string_4)
lastItem = List.LastItem(list=split_3)
string_5 = StringInput(".")
split_4 = String.Split(string=lastItem, separator0=string_5)
firstItem_3 = List.FirstItem(list=split_4)

# group: gerar csv com lista de famílias de porta que não foram contempladas pela rotina
watch_6 = Watch(if_3)
filterByBoolMask_5 = List.FilterByBoolMask(list=trimWhitespace, mask=code_block_36)
watch_7 = Watch(filterByBoolMask_5.in)
list_create = List.Create(item0=firstItem_3, item1=watch_7)
flatten_4 = List.Flatten(list=list_create)
exportCSV = Data.ExportCSV(filePath=watch_6, data=flatten_4)
