# Dynamo graph PT- DIM-DET_script.dyn (Dynamo 2.17.0.3472)
# author: Luís Eduardo Maia Ferreira
# Redimensiona detalhes tipicos duplicados

# group: LISTAR TODAS AS FAMÍLIAS DE DETALHE DE PORTA
categories = Categories("OST_DetailComponents")
views = Views("DET. ESQUADRIAS")
all_elements_of_category_in_view = ElementsOfCategoryInView(Category=categories, View=views)
getFamily = FamilyInstance.GetFamily(familyInstance=all_elements_of_category_in_view)
string_from_object = FromObject(object=getFamily)
code_block = CodeBlock { "DET-PORT"; }
contains = String.Contains(string=string_from_object, searchFor=code_block)
filterByBoolMask = List.FilterByBoolMask(list=getFamily, mask=contains)

watch = Watch(filterByBoolMask.in)

# group: PEGAR OS TIPOS E APLICAR UM FILYTO PARA TIRAR A "PORTA BASE"
types = Family.Types(family=watch)
name = Element.Name(element=types)
code_block_2 = CodeBlock { "PORTA BASE"; }
contains_2 = String.Contains(string=name, searchFor=code_block_2)
filterByBoolMask_2 = List.FilterByBoolMask(list=types, mask=contains_2)
flatten = List.Flatten(list=filterByBoolMask_2.out)
watch_2 = Watch(flatten)

watch_3 = Watch(watch_2)

# group: DIVIDIR A LISTA EM PARTES COM CADA PARAMETRO QUE PRECISAMOS
name_2 = Element.Name(element=watch_2)
code_block_3 = CodeBlock { " - "; " x "; }
replace = String.Replace(string=name_2, searchFor=code_block_3.out0, replaceWith=code_block_3.out1)
code_block_4 = CodeBlock { " x "; }
split = String.Split(string=replace, separator0=code_block_4)
flatten_2 = List.Flatten(list=split)

# group: PEGAR ALTURA
number = DoubleInput(4)
number_2 = DoubleInput(3)
takeEveryNthItem = List.TakeEveryNthItem(list=flatten_2, n=number, offset=number_2)

toNumber = String.ToNumber(string=takeEveryNthItem)

# group: DEFINIRA ALTURA
watch_4 = Watch(watch_3)
code_block_5 = CodeBlock { "PORTA-ALTURA-LUZ"; }
setParameterByName = Element.SetParameterByName(element=watch_4, parameterName=code_block_5, value=toNumber)

# group: PEGAR MARCA DE TIPO
number_3 = DoubleInput(4)
number_4 = DoubleInput(4)
takeEveryNthItem_2 = List.TakeEveryNthItem(list=flatten_2, n=number_3, offset=number_4)

# group: DEFINIRA PEITORIL
watch_5 = Watch(watch_3)
code_block_6 = CodeBlock { "CODIGO DA PORTA"; }
setParameterByName_2 = Element.SetParameterByName(element=watch_5, parameterName=code_block_6, value=takeEveryNthItem_2)

# group: PEGAR LARGURA
number_5 = DoubleInput(4)
number_6 = DoubleInput(2)
takeEveryNthItem_3 = List.TakeEveryNthItem(list=flatten_2, n=number_5, offset=number_6)

toNumber_2 = String.ToNumber(string=takeEveryNthItem_3)

# group: DEFINIRA LARGURA
watch_6 = Watch(watch_3)
code_block_7 = CodeBlock { "PORTA-LARGURA-LUZ"; }
setParameterByName_3 = Element.SetParameterByName(element=watch_6, parameterName=code_block_7, value=toNumber_2)

isEmpty = List.IsEmpty(list=setParameterByName_3)
code_block_8 = CodeBlock()
# ---------- code_block_8.designscript (2 lines) ----------
"Parece que nada aconteceu";
"Detalhes redimensionados! Utilize a vista 'DET. ESQUADRIAS' para montar sua(s) prancha(s)";
# ----------------------------------------
if_ = RefactoredIf(test=isEmpty, true=code_block_8.out0, false=code_block_8.out1)

# group: Helpers.SimpleUserMessage substituto
python_script = Python(IN[0]=if_)  # CPython3
# ---------- python_script.python (18 lines) ----------
import clr
clr.AddReference("System.Windows.Forms")
from System.Windows.Forms import MessageBox, MessageBoxButtons, MessageBoxIcon

# Obtenha a mensagem de entrada
input_data = IN[0]

# Converta para string, caso necessário
if isinstance(input_data, list):
    message = "\n".join(map(str, input_data))
else:
    message = str(input_data)

# Exiba o pop-up com a mensagem
MessageBox.Show(message, "Mensagem", MessageBoxButtons.OK, MessageBoxIcon.Information)

# Saída do script
OUT = "Mensagem exibida com sucesso!"
# ----------------------------------------

watch_7 = Watch(all_elements_of_category_in_view)

# group: PEGAR OS ELEMENTOS NA VISTA
string_from_object_2 = FromObject(object=watch_7)
code_block_9 = CodeBlock { "PORT"; }
contains_3 = String.Contains(string=string_from_object_2, searchFor=code_block_9)
filterByBoolMask_3 = List.FilterByBoolMask(list=watch_7, mask=contains_3)

watch_8 = Watch(filterByBoolMask_3.in)

# group: PEGAR AS QUE TEM AO MENOS 2 TIPOS
getFamily_2 = FamilyInstance.GetFamily(familyInstance=watch_8)
types_2 = Family.Types(family=getFamily_2)
count = List.Count(list=types_2@L2)
code_block_10 = CodeBlock { 2; }
ge = count >= code_block_10
filterByBoolMask_4 = List.FilterByBoolMask(list=watch_8, mask=ge)

# group: DESTACAR OS ELEMENTOS
color_palette = ColorPalette({R: 255, G: 0, B: 255, A: 255})
overrideColorInView = Element.OverrideColorInView(element=filterByBoolMask_4.in, color=color_palette)

python_script_2 = Python(IN[0]=views)  # IronPython2
# ---------- python_script_2.python (29 lines) ----------
# referencias .NET e Dynamo/Revit
import clr
clr.AddReference('RevitAPI')
clr.AddReference('RevitServices')
clr.AddReference('RevitNodes')

import Revit
clr.ImportExtensions(Revit.Elements)

from Autodesk.Revit.DB import View
from RevitServices.Persistence import DocumentManager

# ----------------------------------------------------------------
# — ENTRADAS —
# IN[0] = elemento de vista (Dynamo View) que queremos ativar
# ----------------------------------------------------------------

# obtém o UIDocument atual
uidoc = DocumentManager.Instance.CurrentUIDocument

# converte de Dynamo (Revit.Elements.View) para Autodesk.Revit.DB.View
view_to_activate = UnwrapElement(IN[0])

# solicita ao Revit que troque a vista ativa
# (não é necessário iniciar transação, pois não altera nada no modelo)
uidoc.RequestViewChange(view_to_activate)

# opcional: saída para verificar no Dynamo
OUT = view_to_activate
# ----------------------------------------
