# Dynamo graph pontos_script.dyn (Dynamo 2.17.0.3472)

python_script = Python()  # IronPython2; unwired: IN[0]
# ---------- python_script.python (60 lines) ----------
# -*- coding: utf-8 -*-

# Importar bibliotecas comuns (Common Language Runtime)
import clr

# Importar APIs do Revit
clr.AddReference('RevitAPI')
clr.AddReference('RevitAPIUI')
from Autodesk.Revit.DB import *
from Autodesk.Revit.UI import *

# Importar bibliotecas do .NET para criar listas de IDs
import System
from System.Collections.Generic import List

# Importar serviços do Revit (para acesso ao Documento no Dynamo)
clr.AddReference('RevitServices')
import RevitServices
from RevitServices.Persistence import DocumentManager

# Obter o documento e a interface de usuário (UI) do documento atual
doc = DocumentManager.Instance.CurrentDBDocument
uidoc = DocumentManager.Instance.CurrentUIApplication.ActiveUIDocument

# Inicializar a variável que armazenará o Ponto de Vistoria
survey_point = None

# --- Lógica Principal ---

# 1. Criar um coletor de elementos no documento
collector = FilteredElementCollector(doc)

# 2. Filtrar o coletor para encontrar apenas elementos da classe 'BasePoint'
all_base_points = collector.OfClass(BasePoint).ToElements()

# 3. Iterar pelos BasePoints encontrados
for bp in all_base_points:
    # O Ponto de Vistoria (Survey Point) é o 'BasePoint'
    # cuja propriedade 'IsShared' é True.
    if bp.IsShared:
        survey_point = bp
        break # Encontramos o que queríamos, podemos parar o loop

# --- Saída e Seleção ---

if survey_point:
    # 4. Se encontramos o Ponto de Vistoria, vamos selecioná-lo na UI
    
    # Criar uma lista .NET de ElementIds
    ids_to_select = List[ElementId]()
    ids_to_select.Add(survey_point.Id)
    
    # Definir a seleção atual no Revit para destacar o Ponto de Vistoria
    uidoc.Selection.SetElementIds(ids_to_select)
    
    # 5. Enviar o elemento para a porta de saída (OUT) do nó Python
    OUT = survey_point
else:
    # Se, por algum motivo, não for encontrado
    OUT = None
# ----------------------------------------
python_script_2 = Python()  # IronPython2; unwired: IN[0]
# ---------- python_script_2.python (62 lines) ----------
# -*- coding: utf-8 -*-

# Importar bibliotecas comuns (Common Language Runtime)
import clr

# Importar APIs do Revit
clr.AddReference('RevitAPI')
clr.AddReference('RevitAPIUI')
from Autodesk.Revit.DB import *
from Autodesk.Revit.UI import *

# Importar bibliotecas do .NET para criar listas de IDs
import System
from System.Collections.Generic import List

# Importar serviços do Revit (para acesso ao Documento no Dynamo)
clr.AddReference('RevitServices')
import RevitServices
from RevitServices.Persistence import DocumentManager

# Obter o documento e a interface de usuário (UI) do documento atual
doc = DocumentManager.Instance.CurrentDBDocument
uidoc = DocumentManager.Instance.CurrentUIApplication.ActiveUIDocument

# Inicializar a variável que armazenará o Ponto Base
project_base_point = None

# --- Lógica Principal ---

# 1. Criar um coletor de elementos no documento
collector = FilteredElementCollector(doc)

# 2. Filtrar o coletor para encontrar apenas elementos da classe 'BasePoint'
#    Isso inclui tanto o Ponto Base do Projeto quanto o Ponto de Vistoria (Survey Point)
all_base_points = collector.OfClass(BasePoint).ToElements()

# 3. Iterar pelos BasePoints encontrados
for bp in all_base_points:
    # O Ponto Base do Projeto (PBP) é o 'BasePoint' cuja propriedade 'IsShared' é False.
    # O Ponto de Vistoria (Survey Point) teria 'IsShared' == True.
    if not bp.IsShared:
        project_base_point = bp
        break # Encontramos o que queríamos, podemos parar o loop

# --- Saída e Seleção ---

if project_base_point:
    # 4. Se encontramos o PBP, vamos selecioná-lo na UI
    
    # Criar uma lista .NET de ElementIds
    ids_to_select = List[ElementId]()
    ids_to_select.Add(project_base_point.Id)
    
    # Definir a seleção atual no Revit para destacar o PBP
    # Isso é o mesmo que clicar no elemento
    uidoc.Selection.SetElementIds(ids_to_select)
    
    # 5. Enviar o elemento para a porta de saída (OUT) do nó Python
    OUT = project_base_point
else:
    # Se, por algum motivo, não for encontrado
    OUT = None
# ----------------------------------------
python_script_3 = Python(IN[0]=python_script, IN[1]=python_script_2)  # IronPython2
# ---------- python_script_3.python (222 lines) ----------
# -*- coding: utf-8 -*-

import clr
import System # Necessário para System.Enum e System.Math

# --- Importações do Revit e Dynamo ---
clr.AddReference('RevitAPI')
clr.AddReference('RevitAPIUI')
from Autodesk.Revit.DB import *

clr.AddReference('RevitServices')
import RevitServices
from RevitServices.Persistence import DocumentManager

# --- Importações Essenciais para WPF ---
clr.AddReference('PresentationFramework')
clr.AddReference('PresentationCore')
clr.AddReference('WindowsBase')
clr.AddReference('System.Xml')

from System.IO import StringReader
from System.Xml import XmlReader
from System.Windows.Markup import XamlReader
from System.Windows import (Window, Thickness, VerticalAlignment, HorizontalAlignment, 
                            FontWeights, SizeToContent, TextAlignment) 
# --- CORREÇÃO 1: Importar TextBox ---
from System.Windows.Controls import (TextBlock, Label, Grid, StackPanel, 
                                     GroupBox, Button, TextBox) 
from System.Windows.Media import Brushes, BrushConverter
from System.Globalization import CultureInfo, NumberStyles

# --- Constantes e Helpers ---
FEET_TO_METERS = 0.3048
PI = System.Math.PI

def format_coord_to_br(value_in_feet):
    """Converte de pés para metros e formata para o padrão brasileiro (3 casas, vírgula)."""
    meters = value_in_feet * FEET_TO_METERS
    return meters.ToString("N3", CultureInfo("pt-BR"))

def get_param_value_as_formatted_string(element, param_name, is_angle=False):
    """Busca o valor numérico, converte (se necessário) e formata com precisão."""
    try:
        param = element.LookupParameter(param_name)
        if not param:
            return "Não encontrado"
        if is_angle:
            degrees = param.AsDouble() * (180.0 / PI) 
            return degrees.ToString("N2", CultureInfo("pt-BR")) + u"°" 
        value_in_feet = param.AsDouble() 
        return format_coord_to_br(value_in_feet) 
    except Exception as e:
        return "Erro: " + str(e)

# --- CORREÇÃO 2: Função 'create_cell' modificada ---
def create_cell(content, row, col, is_header=False, align='Center'):
    """Cria um TextBox (selecionável) para ser inserido na Grid WPF."""
    
    # 1. Criar um TextBox
    text_box = TextBox()
    text_box.Text = unicode(content)
    
    # 2. Definir alinhamento do texto
    text_box.TextAlignment = System.Enum.Parse(TextAlignment, align)
    
    # 3. Alinhar o conteúdo verticalmente (diferente de TextBlock)
    text_box.VerticalContentAlignment = VerticalAlignment.Center
    
    # 4. Definir espaçamento interno (padding) em vez de externo (margin)
    text_box.Padding = Thickness(5)
    
    # 5. --- A MÁGICA PARA PARECER UM RÓTULO ---
    text_box.IsReadOnly = True      # Não deixa editar
    text_box.BorderThickness = Thickness(0) # Remove a borda
    
    # 6. Definir estilos (como antes)
    if is_header:
        text_box.FontWeight = FontWeights.Bold
        text_box.Background = BrushConverter().ConvertFromString("#EEE")
    else:
        text_box.Background = Brushes.White # Fundo branco padrão da célula
        
    # 7. Adicionar à Grid
    Grid.SetRow(text_box, row)
    Grid.SetColumn(text_box, col)
    return text_box

# --- Obter Entradas do Dynamo ---
try:
    wrapped_sp = IN[0]
    wrapped_pbp = IN[1]
    
    doc = DocumentManager.Instance.CurrentDBDocument

    if not wrapped_sp or not wrapped_pbp:
        raise System.Exception("Uma ou ambas as entradas (IN[0], IN[1]) estão vazias (None).")
    
    sp_element = doc.GetElement(ElementId(wrapped_sp.Id))
    pbp_element = doc.GetElement(ElementId(wrapped_pbp.Id))
    
    if not sp_element or not pbp_element:
        raise System.Exception("Falha ao 'desembrulhar' (unwrap) os elementos.")

    # --- 1. Extrair Dados: Ponto de Vistoria (SP) ---
    sp_bbox = sp_element.get_BoundingBox(None)
    
    if not sp_bbox:
         raise System.Exception("Não foi possível obter a geometria do Ponto de Vistoria (SP).")
         
    sp_center = (sp_bbox.Min + sp_bbox.Max) / 2.0
    sp_x = format_coord_to_br(sp_center.X)
    sp_y = format_coord_to_br(sp_center.Y)
    sp_z = format_coord_to_br(sp_center.Z)
    
    sp_ns = get_param_value_as_formatted_string(sp_element, "N/S")
    sp_lo = get_param_value_as_formatted_string(sp_element, "L/O")
    sp_elev = get_param_value_as_formatted_string(sp_element, "Elev")
    sp_angle = "Não se aplica" 

    # --- 2. Extrair Dados: Ponto Base do Projeto (PBP) ---
    pbp_bbox = pbp_element.get_BoundingBox(None)
    
    if not pbp_bbox:
         raise System.Exception("Não foi possível obter a geometria do Ponto Base do Projeto (PBP).")
         
    pbp_center = (pbp_bbox.Min + pbp_bbox.Max) / 2.0
    pbp_x = format_coord_to_br(pbp_center.X)
    pbp_y = format_coord_to_br(pbp_center.Y)
    pbp_z = format_coord_to_br(pbp_center.Z)
    
    pbp_ns = get_param_value_as_formatted_string(pbp_element, "N/S")
    pbp_lo = get_param_value_as_formatted_string(pbp_element, "L/O")
    pbp_elev = get_param_value_as_formatted_string(pbp_element, "Elev")
    pbp_angle = get_param_value_as_formatted_string(pbp_element, "Ângulo para norte verdadeiro", is_angle=True)

except Exception as e:
    OUT = "Erro ao ler dados dos elementos. Detalhe: " + str(e)
    raise System.Exception("Erro nos inputs: " + str(e))


# --- Definição da Interface (XAML) ---
# (O XAML permanece o mesmo)
xaml_string = """
<Window xmlns="http://schemas.microsoft.com/winfx/2006/xaml/presentation"
        xmlns:x="http://schemas.microsoft.com/winfx/2006/xaml"
        Title="Coordenadas dos Pontos Base" 
        Width="1100" 
        SizeToContent="WidthAndHeight" 
        WindowStartupLocation="CenterScreen" 
        Topmost="True" 
        ResizeMode="CanResizeWithGrip">
    
    <StackPanel Margin="15">
        
        <Grid x:Name="dataGrid" ShowGridLines="True" Margin="0,0,0,10">
            <Grid.ColumnDefinitions>
                <ColumnDefinition Width="Auto" MinWidth="260" /> <ColumnDefinition Width="Auto" MinWidth="80" />  <ColumnDefinition Width="Auto" MinWidth="80" />  <ColumnDefinition Width="Auto" MinWidth="80" />  <ColumnDefinition Width="Auto" MinWidth="110" /> <ColumnDefinition Width="Auto" MinWidth="110" /> <ColumnDefinition Width="Auto" MinWidth="110" /> <ColumnDefinition Width="*" MinWidth="150" />  </Grid.ColumnDefinitions>
            <Grid.RowDefinitions>
                <RowDefinition Height="Auto" /> <RowDefinition Height="Auto" /> <RowDefinition Height="Auto" /> </Grid.RowDefinitions>
        </Grid>
        
        <Button x:Name="btnClose" Content="Fechar" Width="100" HorizontalAlignment="Right" Margin="0,10,0,0" IsDefault="True" />
        
    </StackPanel>
</Window>
"""

# --- Lógica da Janela ---
# (Esta seção permanece a mesma)
output = "Janela não inicializada."

try:
    reader = StringReader(xaml_string)
    xml_reader = XmlReader.Create(reader)
    window = XamlReader.Load(xml_reader)
    
    grid = window.FindName("dataGrid")
    
    # --- Linha 0: Headers ---
    grid.Children.Add(create_cell("PONTO", 0, 0, True))
    grid.Children.Add(create_cell("X(metros)", 0, 1, True))
    grid.Children.Add(create_cell("Y(metros)", 0, 2, True))
    grid.Children.Add(create_cell("Z(metros)", 0, 3, True))
    grid.Children.Add(create_cell("N/S(metros)", 0, 4, True))
    grid.Children.Add(create_cell("L/O(metros)", 0, 5, True))
    grid.Children.Add(create_cell("ELEV. (metros)", 0, 6, True))
    grid.Children.Add(create_cell("ÂNGULO PARA N. VERDADEIRO (graus)", 0, 7, True))
    
    # --- Linha 1: Ponto de Vistoria (SP) ---
    grid.Children.Add(create_cell(u"▲ PONTO DE LEVANTAMENTO TOPOGRÁFICO", 1, 0, align='Left'))
    grid.Children.Add(create_cell(sp_x, 1, 1, align='Right'))
    grid.Children.Add(create_cell(sp_y, 1, 2, align='Right'))
    grid.Children.Add(create_cell(sp_z, 1, 3, align='Right'))
    grid.Children.Add(create_cell(sp_ns, 1, 4, align='Right'))
    grid.Children.Add(create_cell(sp_lo, 1, 5, align='Right'))
    grid.Children.Add(create_cell(sp_elev, 1, 6, align='Right'))
    grid.Children.Add(create_cell(sp_angle, 1, 7, align='Center'))
    
    # --- Linha 2: Ponto Base do Projeto (PBP) ---
    grid.Children.Add(create_cell(u"⌖ POTO BASE DO PROJETO", 2, 0, align='Left'))
    grid.Children.Add(create_cell(pbp_x, 2, 1, align='Right'))
    grid.Children.Add(create_cell(pbp_y, 2, 2, align='Right'))
    grid.Children.Add(create_cell(pbp_z, 2, 3, align='Right'))
    grid.Children.Add(create_cell(pbp_ns, 2, 4, align='Right'))
    grid.Children.Add(create_cell(pbp_lo, 2, 5, align='Right'))
    grid.Children.Add(create_cell(pbp_elev, 2, 6, align='Right'))
    grid.Children.Add(create_cell(pbp_angle, 2, 7, align='Right'))

    def close_window(sender, e):
        window.Close()

    close_button = window.FindName("btnClose")
    close_button.Click += close_window
    
    window.ShowDialog()
    
    output = "Janela exibida e fechada pelo usuário."

except Exception as e:
    output = "Erro ao criar janela WPF: " + str(e)

OUT = output
# ----------------------------------------
